% Simulink data dictionary motor_data.sldd

csro_code_gen_config = Simulink.ConfigSet(StartTime="0", StopTime="100", FixedStep="0.1", Solver="FixedStepAuto", ProdHWDeviceType="ARM Compatible->ARM Cortex-M", SystemTargetFile="ert.tlc", TargetLang="C")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
sys_regs = Simulink.Signal(StorageClass="ImportFromFile", HeaderFile="fnd_com.h", DataType="Bus: modbus_regs")

modbus_regs = Simulink.Bus(DataScope="Imported", HeaderFile="mb_config.h")
  discs: uint8[256]
  coils: uint8[256]
  inputs: int16[256]
  holdings: int16[256]

relay = Simulink.Signal(DataType="int16", Dimensions=8)
f2_ctrl_config = Simulink.ConfigSet(StartTime="0", StopTime="10", FixedStep="0.1", Solver="FixedStepAuto", ProdHWDeviceType="ARM Compatible->ARM Cortex-M", SystemTargetFile="ert.tlc", TargetLang="C")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
ee_ram = Simulink.Signal(StorageClass="ImportFromFile", HeaderFile="ee.h", DataType="uint8", Dimensions=128)
Configuration = Simulink.ConfigSet(StartTime="0", StopTime="10", RelTol="1e-3", Solver="VariableStepAuto", ProdHWDeviceType="Intel->x86-64 (Windows64)", SystemTargetFile="grt.tlc", TargetLang="C")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